# Grasshopper definition daisy builder.gh (Grasshopper 1.0.8)

# adjust flower size
flower_proportion = Slider(2.396, range=0..10)
# Change petal width
petal_width = Slider(3.293, range=0..5)
# Change petal length
petal_length = Slider(7.861, range=0..10)
translate_petal_y = Slider(5.156, range=0..10)
sloth_depth = Slider(10, range=0..20)
# adjust slot width based on your material thickness
slot_width = Slider(2.2, range=0..10)
# Change if you want the slots to be further in or out from the center
slot_move_multiplier = Slider(8.065, range=0..20)
# Don't change this or your slots will be off-centered
centering_calc = Slider(-2, range=-10..10.001)
multiplication = Multiplication(A=petal_width, B=flower_proportion)
multiplication_2 = Multiplication(A=flower_proportion, B=petal_length)
multiplication_3 = Multiplication(A=flower_proportion, B=translate_petal_y)
# change tab proportion
multiplier = Slider(1.675, range=0..20)
multiplication_4 = Multiplication(A=flower_proportion, B=sloth_depth)
division = Division(A=slot_width, B=centering_calc)
multiplication_5 = Multiplication(A=flower_proportion, B=slot_move_multiplier)
vector_xyz = VectorXYZ(XComponent=division, YComponent=multiplication_5, ZComponent=0)  # -> Vector, Length
slot_rectangle = Rectangle(Plane=PlaneXY(0, 0, 0), XSize=slot_width, YSize=multiplication_4, Radius=0)  # -> Rectangle, Length
multiplication_6 = Multiplication(A=multiplication, B=multiplier)
multiplication_7 = Multiplication(A=multiplication_2, B=multiplier)
move_slot = Move(Geometry=slot_rectangle.Rectangle, Motion=vector_xyz.Vector)  # -> Geometry, Transform
vector_xyz_2 = VectorXYZ(XComponent=0, YComponent=multiplication_3, ZComponent=0)  # -> Vector, Length
petal = Ellipse(Plane=PlaneXY(0, 0, 0), Radius1=multiplication, Radius2=multiplication_2)  # -> Ellipse, Focus1, Focus2
centering_calc_2 = Slider(-2, range=-10..10.001)
# Change circle size relative to petals
circle_size_factor = Slider(2.297, range=0..10)
division_2 = Division(A=multiplication_6, B=centering_calc_2)
vector_xyz_3 = VectorXYZ(XComponent=division_2, YComponent=0, ZComponent=0)  # -> Vector, Length
tab_rectangle = Rectangle(Plane=PlaneXY(0, 0, 0), XSize=multiplication_6, YSize=multiplication_7, Radius=0)  # -> Rectangle, Length
multiplication_8 = Multiplication(A=flower_proportion, B=circle_size_factor)
move_tab = Move(Geometry=tab_rectangle.Rectangle, Motion=vector_xyz_3.Vector)  # -> Geometry, Transform
# Change number of petals
petal_number = Slider(12, range=0..30)
# Change number of slots and tabs
slot_tab_count = Slider(2, range=0..30)
move_petal = Move(Geometry=petal.Ellipse, Motion=vector_xyz_2.Vector)  # -> Geometry, Transform
polar_array_petal = PolarArray(Geometry=move_petal.Geometry, Plane=PlaneXY(0, 0, 0), Count=petal_number, Angle=6.283185307)  # -> Geometry, Transform
polar_array_tabs = PolarArray(Geometry=move_tab.Geometry, Plane=PlaneXY(0, 0, 0), Count=slot_tab_count, Angle=6.283185307)  # -> Geometry, Transform
circle = Circle(Plane=PlaneXY(0, 0, 0), Radius=multiplication_8)
region_union_petal_tabs = RegionUnion(Curves=[polar_array_petal.Geometry, polar_array_tabs.Geometry])
# Change Extrusion Thickness
extrusion_thickness = Slider(3.25, range=0..10)
unit_z = UnitZ(Factor=extrusion_thickness)
polar_array_slot = PolarArray(Geometry=move_slot.Geometry, Plane=PlaneXY(0, 0, 0), Count=slot_tab_count, Angle=6.283185307)  # -> Geometry, Transform

# ----
# Turn curves in to solids
extrude_petals_tabs = Extrude(Base=region_union_petal_tabs, Direction=unit_z)
extrude_circle = Extrude(Base=circle, Direction=unit_z)
extrude_slot = Extrude(Base=polar_array_slot.Geometry, Direction=unit_z)
cap_holes = CapHoles(Brep=extrude_petals_tabs)
cap_holes_2 = CapHoles(Brep=extrude_circle)
cap_holes_3 = CapHoles(Brep=extrude_slot)
trim_solid = TrimSolid(Shape=cap_holes, Cutters=cap_holes_2)

# ----
# BAKE THIS! :)
trim_solid_2 = TrimSolid(Shape=trim_solid, Cutters=cap_holes_3)
