# Grasshopper definition BoxGenerator.gh (Grasshopper 1.0.8)

lid_slot_thickness = Slider(2, range=0..5)

# ----
# PARAMETERS
box_width = Slider(50, range=0..100)
box_length = Slider(50, range=0..100)
wall_thickness = Slider(4, range=4..5)
box_height = Slider(28, range=0..100)

divide_by_two_int = Integer(2)
division = Division(A=wall_thickness, B=divide_by_two_int)
pushfit_tolerance = Slider(0.1, range=0..3)
# Pushfit Depth
number_slider = Slider(2.5, range=0..4)
# Pushfit Height
number_slider_2 = Slider(2.5, range=0..4)
buffer_5mm_on_either_side = Integer(10)

# ----
# MAKE BOX
# Creates hollow cube
# Center inner rectangle
_2 = Integer(2)
multiplication = Multiplication(A=wall_thickness, B=_2)
multiplication_2 = Multiplication(A=wall_thickness, B=_2)
vector_xyz = VectorXYZ(XComponent=wall_thickness, YComponent=wall_thickness, ZComponent=0)  # -> Vector, Length
subtraction = Subtraction(A=box_length, B=multiplication)
subtraction_2 = Subtraction()
subtraction_3 = Subtraction(A=box_width, B=multiplication_2)
outer_rectangle = Rectangle(Plane=PlaneXY(0, 0, 0), XSize=box_width, YSize=box_length, Radius=0)  # -> Rectangle, Length
inner_rectangle = Rectangle(Plane=PlaneXY(0, 0, 0), XSize=subtraction_3, YSize=subtraction, Radius=0)  # -> Rectangle, Length
move = Move(Geometry=inner_rectangle.Rectangle, Motion=vector_xyz.Vector)  # -> Geometry, Transform
subtraction_4 = Subtraction(A=box_height, B=wall_thickness)
box_rectangle = BoxRectangle(Rectangle=outer_rectangle.Rectangle, Height=box_height)
box_rectangle_2 = BoxRectangle(Rectangle=move.Geometry, Height=subtraction_4)
vector_xyz_2 = VectorXYZ(XComponent=0, YComponent=0, ZComponent=wall_thickness)  # -> Vector, Length
move_2 = Move(Geometry=box_rectangle_2, Motion=vector_xyz_2.Vector)  # -> Geometry, Transform
solid_difference = SolidDifference(BrepsA=box_rectangle, BrepsB=move_2.Geometry)

# ----
# Bottom of negative lid object
# Union negative lid object
# Top of negative lid object
divide_by_two_int_2 = Integer(2)
division_2 = Division(A=wall_thickness, B=divide_by_two_int_2)
subtraction_5 = Subtraction(A=box_length, B=wall_thickness)
subtraction_6 = Subtraction(A=box_width, B=wall_thickness)
subtraction_7 = Subtraction(A=box_length, B=division_2)
vector_xyz_3 = VectorXYZ(XComponent=division_2, YComponent=0, ZComponent=0)  # -> Vector, Length
vector_xyz_4 = VectorXYZ(XComponent=wall_thickness, YComponent=0, ZComponent=lid_slot_thickness)  # -> Vector, Length
# CREATE NEGATIVE LID OBJECT
rectangle = Rectangle(Plane=PlaneXY(0, 0, 0), XSize=subtraction_6, YSize=subtraction_7, Radius=0)  # -> Rectangle, Length
rectangle_2 = Rectangle(Plane=PlaneXY(0, 0, 0), XSize=subtraction_3, YSize=subtraction_5, Radius=0)  # -> Rectangle, Length
move_3 = Move(Geometry=rectangle.Rectangle, Motion=vector_xyz_3.Vector)  # -> Geometry, Transform
move_4 = Move(Geometry=rectangle_2.Rectangle, Motion=vector_xyz_4.Vector)  # -> Geometry, Transform
box_rectangle_3 = BoxRectangle(Rectangle=move_3.Geometry, Height=lid_slot_thickness)
box_rectangle_4 = BoxRectangle(Rectangle=move_4.Geometry, Height=lid_slot_thickness)
solid_union = SolidUnion(Breps=[box_rectangle_3, box_rectangle_4])

# ----
# PUSHFIT COMPONENTS
_2_2 = Integer(2)
subtraction_8 = Subtraction(A=box_length, B=buffer_5mm_on_either_side)
multiplication_3 = Multiplication(A=pushfit_tolerance, B=_2_2)
tolerance = Slider(0.8, range=0..1)

# ----
# Bottom of lid
# Top of Lid
# CREATE LID
divide_by_two_int_3 = Integer(2)
division_3 = Division(A=tolerance, B=divide_by_two_int_3)
subtraction_9 = Subtraction(A=subtraction_7, B=division_3)
subtraction_10 = Subtraction(A=subtraction_6, B=tolerance)
subtraction_11 = Subtraction(A=subtraction_3, B=tolerance)
subtraction_12 = Subtraction(A=subtraction_5, B=division_3)
vector_xyz_5 = VectorXYZ(XComponent=division_3, YComponent=0, ZComponent=0)  # -> Vector, Length
vector_xyz_6 = VectorXYZ(XComponent=wall_thickness, YComponent=0, ZComponent=0)  # -> Vector, Length
rectangle_3 = Rectangle(Plane=PlaneXY(0, 0, 0), XSize=subtraction_10, YSize=subtraction_9, Radius=0)  # -> Rectangle, Length
rectangle_4 = Rectangle(Plane=PlaneXY(0, 0, 0), XSize=subtraction_11, YSize=subtraction_12, Radius=0)  # -> Rectangle, Length
move_5 = Move(Geometry=rectangle_3.Rectangle, Motion=vector_xyz_3.Vector)  # -> Geometry, Transform
move_6 = Move(Geometry=rectangle_4.Rectangle, Motion=vector_xyz_6.Vector)  # -> Geometry, Transform
_2_3 = Integer(2)
move_7 = Move(Geometry=move_5.Geometry, Motion=vector_xyz_5.Vector)  # -> Geometry, Transform
move_8 = Move(Geometry=move_6.Geometry, Motion=vector_xyz_5.Vector)  # -> Geometry, Transform
multiplication_4 = Multiplication(A=_2_3, B=lid_slot_thickness)
subtraction_13 = Subtraction(A=lid_slot_thickness, B=division_3)
box_rectangle_5 = BoxRectangle(Rectangle=move_7.Geometry, Height=subtraction_13)
box_rectangle_6 = BoxRectangle(Rectangle=move_8.Geometry, Height=multiplication_4)

subtraction_14 = Subtraction(A=number_slider, B=multiplication_3)
subtraction_15 = Subtraction(A=subtraction_8, B=multiplication_3)
rotation_degrees = Slider(90, range=0..360)
vector_xyz_7 = VectorXYZ(XComponent=0, YComponent=0, ZComponent=0)  # -> Vector, Length
rectangle_5 = Rectangle(Plane=PlaneXY(0, 0, 0), XSize=subtraction_15, YSize=subtraction_14, Radius=0)  # -> Rectangle, Length
radians = Radians(Degrees=rotation_degrees)
move_9 = Move(Geometry=rectangle_5.Rectangle, Motion=vector_xyz_7.Vector)  # -> Geometry, Transform
rectangle_6 = Rectangle(Plane=PlaneXY(0, 0, 0), XSize=subtraction_8, YSize=number_slider, Radius=0)  # -> Rectangle, Length
_2_4 = Integer(2)
multiplication_5 = Multiplication(A=lid_slot_thickness, B=_2_4)
# Bigger
rotate = Rotate(Geometry=rectangle_6.Rectangle, Angle=radians, Plane=PlaneXY(0, 0, 0))  # -> Geometry, Transform
# Smaller (minus tolerance)
rotate_2 = Rotate(Geometry=move_9.Geometry, Angle=radians, Plane=PlaneXY(0, 0, 0))  # -> Geometry, Transform
subtraction_16 = Subtraction(A=box_height, B=multiplication_5)
vector_xyz_8 = VectorXYZ(XComponent=0, YComponent=0, ZComponent=subtraction_16)  # -> Vector, Length
subtraction_17 = Subtraction(A=number_slider_2, B=multiplication_3)
_2_5 = Integer(2)
vector_xyz_9 = VectorXYZ(XComponent=0, YComponent=pushfit_tolerance, ZComponent=pushfit_tolerance)  # -> Vector, Length

box_rectangle_7 = BoxRectangle(Rectangle=rotate_2.Geometry, Height=subtraction_17)
# Bigger
box_rectangle_8 = BoxRectangle(Rectangle=rotate.Geometry, Height=number_slider_2)
# Smaller (minus tolerance)
move_10 = Move(Geometry=box_rectangle_7, Motion=vector_xyz_9.Vector)  # -> Geometry, Transform

move_11 = Move(Geometry=solid_union, Motion=vector_xyz_8.Vector)  # -> Geometry, Transform
division_4 = Division(A=buffer_5mm_on_either_side, B=_2_5)
division_5 = Division(A=buffer_5mm_on_either_side, B=_2_5)
vector_xyz_10 = VectorXYZ(XComponent=0, YComponent=division_5, ZComponent=division_4)  # -> Vector, Length
integer = Integer(10)
addition = Addition(A=box_width, B=integer)
move_12 = Move(Geometry=box_rectangle_8, Motion=vector_xyz_10.Vector)  # -> Geometry, Transform
move_13 = Move(Geometry=move_10.Geometry, Motion=vector_xyz_10.Vector)  # -> Geometry, Transform
vector_xyz_11 = VectorXYZ(XComponent=addition, YComponent=0, ZComponent=0)  # -> Vector, Length
solid_union_2 = SolidUnion(Breps=[box_rectangle_5, box_rectangle_6])

# ----
# Pushfit Negative (Bigger)
# Pushfit Positive (Smaller)
_2_6 = Integer(2)
_2_7 = Integer(2)
multiplication_6 = Multiplication(A=number_slider_2, B=_2_6)
multiplication_7 = Multiplication(A=number_slider_2, B=_2_7)
subtraction_18 = Subtraction(A=box_height, B=multiplication_7)
subtraction_19 = Subtraction(A=box_height, B=multiplication_6)
_2_8 = Integer(10)
_2_9 = Integer(10)
subtraction_20 = Subtraction(A=subtraction_19, B=_2_8)
subtraction_21 = Subtraction(A=subtraction_18, B=_2_9)
_2_10 = Integer(2)
vector_xyz_12 = VectorXYZ(XComponent=0, YComponent=0, ZComponent=subtraction_20)  # -> Vector, Length
vector_xyz_13 = VectorXYZ(XComponent=0, YComponent=0, ZComponent=subtraction_21)  # -> Vector, Length
linear_array = LinearArray(Geometry=move_13.Geometry, Direction=vector_xyz_13.Vector, Count=_2_10)  # -> Geometry, Transform
vector_xyz_14 = VectorXYZ(XComponent=box_width, YComponent=0, ZComponent=0)  # -> Vector, Length
linear_array_2 = LinearArray(Geometry=move_12.Geometry, Direction=vector_xyz_12.Vector, Count=_2_10)  # -> Geometry, Transform
move_14 = Move(Geometry=linear_array.Geometry, Motion=vector_xyz_14.Vector)  # -> Geometry, Transform

# ----
# BOX WITHOUT ATTACHMENTS
solid_difference_2 = SolidDifference(BrepsA=solid_difference, BrepsB=move_11.Geometry)

# ----
# LID
move_15 = Move(Geometry=solid_union_2, Motion=vector_xyz_11.Vector)  # -> Geometry, Transform

solid_difference_3 = SolidDifference(BrepsA=solid_difference_2, BrepsB=move_14.Geometry)

# ----
# Box With Attachments
solid_union_3 = SolidUnion(Breps=[solid_difference_3, linear_array_2.Geometry])  # -> reverse(Result)
